% Simulink data dictionary JointData.sldd

ia = Simulink.Signal(DataType="single")
ib = Simulink.Signal(DataType="single")
ic = Simulink.Signal(DataType="single")
Rs = Simulink.Parameter(6.97, DataType="single")
flux = Simulink.Parameter(0.016884, DataType="single")
L = Simulink.Parameter(0.00535, DataType="single")
ThetaOpen = Simulink.Signal(DataType="single")